# Dynamo graph revit_mcp_next_host_smoke.dyn "Revit MCP Next Host Smoke" (Dynamo 2.19.3.6394)
# author: Revit MCP Next
# Runs the Revit MCP Next hosted Dynamo smoke inside Dynamo for Revit and writes JSON evidence.

revit_mcp_next_host_smoke = Python()  # CPython3
# ---------- revit_mcp_next_host_smoke.python (56 lines) ----------
import os
import sys


def candidate_python_dirs():
    dirs = []
    auth_config = os.environ.get("REVIT_MCP_NEXT_AUTH_CONFIG")
    if auth_config:
        dirs.append(os.path.join(os.path.dirname(os.path.dirname(auth_config)), "integrations", "python"))

    install_root = os.environ.get("REVIT_MCP_NEXT_INSTALL_ROOT")
    if install_root:
        dirs.append(os.path.join(install_root, "integrations", "python"))

    local_app_data = os.environ.get("LOCALAPPDATA")
    if local_app_data:
        dirs.append(os.path.join(local_app_data, "RevitMcpNext", "integrations", "python"))

    app_data = os.environ.get("APPDATA")
    if app_data:
        for year in ("2024", "2025", "2026"):
            dirs.append(os.path.join(app_data, "Autodesk", "Revit", "Addins", year, "RevitMcpNext", "integrations", "python"))

    return dirs


def add_installed_python_client_to_path():
    for python_dir in candidate_python_dirs():
        if os.path.exists(os.path.join(python_dir, "revit_mcp_next_host_smoke.py")):
            if python_dir not in sys.path:
                sys.path.insert(0, python_dir)
            return python_dir
    raise RuntimeError("Unable to find installed Revit MCP Next Python integration helper.")


def add_revit_services_reference():
    try:
        import clr

        clr.AddReference("RevitServices")
    except Exception:
        pass


try:
    add_installed_python_client_to_path()
    add_revit_services_reference()
    from RevitServices.Persistence import DocumentManager
    from revit_mcp_next_host_smoke import run_host_smoke

    uiapp = DocumentManager.Instance.CurrentUIApplication
    evidence_path = os.environ.get("REVIT_MCP_NEXT_DYNAMO_EVIDENCE")
    model_path = os.environ.get("REVIT_MCP_NEXT_DYNAMO_MODEL")
    OUT = run_host_smoke(uiapp, "dynamo", evidence_path=evidence_path, model_path=model_path, raise_on_failure=False)
except Exception as error:
    OUT = {"schemaVersion": 1, "status": "failed", "host": "dynamo", "error": str(error)}
# ----------------------------------------
watch = Watch(revit_mcp_next_host_smoke)
